# Grasshopper definition Python + Grasshopper-tutorial.gh (Grasshopper 1.0.7)

max = Slider(48, range=1..100)
step = Slider(6, range=1..100)
min = Slider(16, range=1..100)
# Genereting  a hight according to the distance to the point
boolean_toggle = BooleanToggle(True)
button = Button()
number_slider = Slider(12, range=0..20)
ey = Slider(10, range=0..20)
point = Point(<point referenced from the Rhino model>)
ghpython_script = GhPythonScript(step=step, max=max, min=min)  # -> out, points, colors
# ---------- ghpython_script: Python ----------
import rhinoscriptsyntax as rs
import System.Drawing as sd


step = int(step)
max = int(max)
min = int(min)

points = []
colors = []


for x in range(min,max,step):
    for y in range(min,max,step):
        for z in range(min,max,step):
            points.append(rs.AddPoint(x,y,z))
            colors.append(sd.Color.FromArgb(x,y,z))
            print(x,y,z)
# ---------- end ghpython_script ----------
ghpython_script_2 = GhPythonScript(sX=number_slider, sY=number_slider, sZ=number_slider, eX=ey, eY=ey, pt=point, bake=boolean_toggle)  # -> out, geo, color; inputs eX: Int32, eY: Int32, pt: Point3d, bake: Boolean
# ---------- ghpython_script_2: Python ----------
import rhinoscriptsyntax as rs
import Rhino
import Rhino.Geometry as rg
import System.Drawing as sd
from Grasshopper.Kernel import GH_RuntimeMessageLevel as rel
import Rhino.DocObjects as rd
import scriptcontext as sc

geo = []
color = []

# Check if eX is an integer, otherwise try to convert it
if not isinstance(eX, int):
    try:
        eX = int(eX)
    except:
        ghenv.Component.AddRuntimeMessage(rel.Warning, "eX allows only integers as input")

# Main loop to create geometry and colors
for x in range(eX): 
    for y in range(eY):
        pt1 = rg.Point3d(x * sX, y * sY, 0)
        pt2 = rg.Point3d(x * sX + 1, y * sY, 0)
        pt3 = rg.Point3d(x * sX, y * sY + 1, 0)
        
        # Create a plane from three points
        plane = rs.PlaneFromPoints(pt1, pt2, pt3)
        
        # Distance calculation and box creation
        dist = rs.Distance(pt, pt1)
        geo.append(
            rg.Box(
                plane,
                rg.Interval(sX / 2 * -0.9, sX / 2),
                rg.Interval(sY / 2 * -0.9, sY / 2),
                rg.Interval(sZ / 2 * -1, dist)
            )
        )
        
        # Set color based on coordinates
        color.append(sd.Color.FromArgb(int(x / eX * 255), int(y / eY * 255), 150))

# Function to bake geometry to Rhino document
def baker():
    # Switch context to Rhino document for baking
    ghdoc = sc.doc
    sc.doc = Rhino.RhinoDoc.ActiveDoc
    
    for k in range(len(geo)):
        # Convert box geometry to brep
        brep = rg.Brep.CreateFromBox(geo[k])
        
        # Set attributes for color
        attr = rd.ObjectAttributes()
        attr.ColorSource = rd.ObjectColorSource.ColorFromObject
        attr.ObjectColor = color[k]
        
        # Add the Brep to the Rhino document
        sc.doc.Objects.AddBrep(brep, attr)
    
    # Restore Grasshopper document context
    sc.doc = ghdoc
    
    # Update the document to reflect changes
    sc.doc.Views.Redraw()

# Execute bake if the bake flag is set to True
if bake:
    baker()
# ---------- end ghpython_script_2 ----------
panel = Panel(ghpython_script.out)
panel_2 = Panel(ghpython_script.colors)
custom_preview = CustomPreview(Geometry=ghpython_script_2.geo, Material=ghpython_script_2.color)
custom_preview_2 = CustomPreview(Geometry=ghpython_script.points, Material=ghpython_script.colors)
